# Grasshopper definition 3DCW_romconfig_battr.gh (Grasshopper 1.0.8)
# plug-ins: RhinoCodePluginGH

pipeline = GeometryPipeline(
    GroupByLayer=False,
    GroupByType=False,
    IncludeHidden=True,
    IncludeLocked=True,
    LayerFilter="Joint",
    NameFilter="*",
    SublayerFiltering=True,
    TypeFilter=4)
pipeline_2 = GeometryPipeline(
    GroupByLayer=False,
    GroupByType=False,
    IncludeHidden=True,
    IncludeLocked=True,
    LayerFilter="BeamH",
    NameFilter="*",
    SublayerFiltering=True,
    TypeFilter=4)
pipeline_3 = GeometryPipeline(
    GroupByLayer=False,
    GroupByType=False,
    IncludeHidden=True,
    IncludeLocked=True,
    LayerFilter="BeamV",
    NameFilter="*",
    SublayerFiltering=True,
    TypeFilter=4)
crv = Curve(pipeline)
crv_2 = Curve(pipeline_2)
crv_3 = Curve(pipeline_3)
pipeline_4 = GeometryPipeline(
    GroupByLayer=False,
    GroupByType=False,
    IncludeHidden=True,
    IncludeLocked=True,
    LayerFilter="battr2",
    NameFilter="*",
    SublayerFiltering=True,
    TypeFilter=4)
pipeline_5 = GeometryPipeline(
    GroupByLayer=False,
    GroupByType=False,
    IncludeHidden=True,
    IncludeLocked=True,
    LayerFilter="battr3",
    NameFilter="*",
    SublayerFiltering=True,
    TypeFilter=4)
pipeline_6 = GeometryPipeline(
    GroupByLayer=False,
    GroupByType=False,
    IncludeHidden=True,
    IncludeLocked=True,
    LayerFilter="battr4",
    NameFilter="*",
    SublayerFiltering=True,
    TypeFilter=4)

# ---- group: Get mesh configs
merge = Merge(Data1=crv, Data2=crv_2, Data3=crv_3)
disc = Discontinuity(Curve=merge, Level=1)  # -> Points, Parameters
item = ListItem(List=disc.Points, Index=0, Wrap=True)  # -> flatten(Item)

# ----
entwine = Entwine(Branch00=crv, Branch01=crv_2, Branch02=crv_3, FlattenInputs=True)
item_2 = ListItem(List=entwine, Index=0, Wrap=True)  # -> flatten(Item)

# ---- group: All curves
crv_4 = Curve(merge)

# ---- group: Get global boundary attributes
pipeline_7 = GeometryPipeline(
    GroupByLayer=False,
    GroupByType=False,
    IncludeHidden=True,
    IncludeLocked=True,
    LayerFilter="battr1",
    NameFilter="*",
    SublayerFiltering=True,
    TypeFilter=4)
crv_5 = Curve(crv_4)
py3 = Python3Script()  # -> bdr_data; inputs mesh_type: list, el_crvs: list of Curve, bdr_crvs: tree of Curve
# ---------- py3: Python ----------
"""Grasshopper Script"""
#! python 3

# r: numpy
# r: h5py

import numpy as np
import h5py
import Rhino.Geometry as rg

def point_in_crv(crv, point):
    containment = crv.Contains(point)
    if containment == rg.PointContainment.Unset:
        return False
    elif containment == rg.PointContainment.Inside:
        return True
    elif containment == rg.PointContainment.Outside:
        return False
    else:
        return True

def line_in_crv(crv,line):
    return point_in_crv(crv, line.From) and point_in_crv(crv, line.To)

def map_cbattr_joint(c_battr):
    return c_battr + 1

def map_cbattr_beamh(c_battr):
    if c_battr == 1 or c_battr == 3:
        return 1
    elif c_battr == 2:
        return 2
    elif c_battr == 4:
        return 3 

def map_cbattr_beamv(c_battr):
    if c_battr == 2 or c_battr == 4:
        return 1
    elif c_battr == 1:
        return 2
    elif c_battr == 3:
        return 3 

def map_cbattr(m_id, c_battr, mesh_type):
    m_type = mesh_type[m_id]
    if m_type == 0:
        return map_cbattr_joint(c_battr)
    elif m_type == 1:
        return map_cbattr_beamh(c_battr)
    elif m_type == 2:
        return map_cbattr_beamv(c_battr)
    else:
        return "error"
    
def get_bdr_attrs(bdr_list, comp_list):
    bdr_attrs = []
    for m_id, m_crv in enumerate(comp_list):
        exp_crvs = m_crv.ToPolyline().GetSegments()
        for k, exp_crv in enumerate(exp_crvs):
            in_crvs = False
            c_battr = k + 1
            for i, b_crvs in enumerate(bdr_list):
                global_bdr_attr = i + 1
                for b_crv in b_crvs:
                    if line_in_crv(b_crv, exp_crv):
                        # global_battr / mesh_idx / comp_battr
                        mcb = map_cbattr(m_id, c_battr, mesh_type)
                        if global_bdr_attr == 4 and m_id == 9:
                            print(c_battr)
                            print(mcb)
                            print(line_in_crv(b_crv, exp_crv))
                        bdr_attrs.append([global_bdr_attr, m_id, mcb])
                        in_crvs = True
            if in_crvs == False:
                mcb = map_cbattr(m_id, c_battr, mesh_type)
                bdr_attrs.append([len(bdr_list) + 1, m_id, mcb]) 
    return bdr_attrs

def get_battr_list(battr_tree):
    battr_list = []
    for i in range(battr_tree.BranchCount):
        branchList = battr_tree.Branch(i)
        battr_list.append([])
        for j in range(branchList.Count):
            battr_list[i].append(branchList[j])
    return battr_list

battr_list = get_battr_list(bdr_crvs)
bdr_data = np.array(get_bdr_attrs(battr_list, el_crvs))
# ---------- end py3 ----------

# ----
entwine_2 = Entwine(Branch00=pipeline_7, Branch01=pipeline_4, Branch02=pipeline_5, Branch03=pipeline_6, FlattenInputs=True)  # -> simplify(Result)

# ---- group: Get mesh configs / mesh config list
pt = Point(item)

# ----
item_3 = ListItem(List=crv_4, Index=0, Wrap=True)
panel = Panel("examples/linelast/config")
explode = Explode(Curve=crv_5, Recursive=True)  # -> Segments, Vertices
path = FilePath("/Users/larsson4/repos/scaleupROM/")
number_slider = Slider(11, range=9..12)
item_4 = ListItem(List=explode.Segments, Index=Slider(1, range=0..3), Wrap=True)
join = TextJoin(Text=["build", panel], Join="/")
py3_2 = Python3Script(mesh_config_pts=pt)  # -> mesh_config; inputs mesh_config_pts: list of Point3d
# ---------- py3_2: Python ----------
#! python 3

# r: numpy
# r: h5py

import numpy as np
import h5py
import Rhino.Geometry as rg

mesh_config = np.array([[pt.X, pt.Y, pt.Z, 0.0, 0.0,0.0] for pt in mesh_config_pts])
# ---------- end py3_2 ----------
py3_3 = Python3Script(el_crvs=crv_5, bdr_crvs=entwine_2)  # -> bdr_data; inputs el_crvs: list of Curve, bdr_crvs: tree of Curve
# ---------- py3_3: Python ----------
"""Grasshopper Script"""
#! python 3

# r: numpy
# r: h5py

import numpy as np
import h5py
import Rhino.Geometry as rg

def point_in_crv(crv, point):
    containment = crv.Contains(point)
    print(containment)
    if containment == rg.PointContainment.Unset:
        return False
    elif containment == rg.PointContainment.Inside:
        return True
    elif containment == rg.PointContainment.Outside:
        return False
    else:
        return True

def line_in_crv(crv,line):
    return point_in_crv(crv, line.From) and point_in_crv(crv, line.To)

def get_bdr_attrs(bdr_list, comp_list):
    bdr_attrs = []
    for m_id, m_crv in enumerate(comp_list):
        exp_crvs = m_crv.ToPolyline().GetSegments()
        for k, exp_crv in enumerate(exp_crvs):
            in_crvs = False
            c_battr = k + 1
            for i, b_crvs in enumerate(bdr_list):
                print(b_crvs)
                global_bdr_attr = i + 1
                for b_crv in b_crvs:
                    if line_in_crv(b_crv, exp_crv):
                        bdr_attrs.append([global_bdr_attr, m_id, c_battr])
                        in_crvs = True
            if in_crvs == False:
                bdr_attrs.append([len(bdr_list) + 1, m_id, c_battr]) 
    return bdr_attrs

def get_battr_list(battr_tree):
    battr_list = []
    for i in range(battr_tree.BranchCount):
        branchList = battr_tree.Branch(i)
        battr_list.append([])
        for j in range(branchList.Count):
            battr_list[i].append(branchList[j])
    return battr_list

battr_list = get_battr_list(bdr_crvs)
bdr_data = np.array(get_bdr_attrs(battr_list, el_crvs))
comph = np.array([[5,i,5] for i in range(len(el_crvs))])
bdr_data = np.vstack([bdr_data, comph])
# ---------- end py3_3 ----------
py3_4 = Python3Script(ref_comps=item_2, el_crvs=crv_4)  # -> mesh_type; inputs ref_comps: list of Rectangle3d, el_crvs: list of Rectangle3d
# ---------- py3_4: Python ----------
#! python 3

# r: numpy
# r: h5py

import numpy as np
import h5py
import Rhino.Geometry as rg
import math
math.isclose(1.233, 1.24)

ref_wh = [[comp.Width, comp.Height] for comp in ref_comps]

def get_mesh_type(el_crv, ref_wh):
    el_w = el_crv.Width
    el_h = el_crv.Height
    for i, rwh in enumerate(ref_wh):
        if math.isclose(el_w, rwh[0]) and math.isclose(el_h, rwh[1]):
            return i

types = [get_mesh_type(el_crv, ref_wh) for el_crv in el_crvs]

assert len(types) == len(el_crvs)

mesh_type = types
# ---------- end py3_4 ----------
item_5 = ListItem(List=crv_5, Index=Slider(21, range=0..100), Wrap=True)
py3_5 = Python3Script(el_crvs=crv_4)  # -> if_data; inputs el_crvs: list of Curve
# ---------- py3_5: Python ----------
"""Grasshopper Script"""
#! python 3

# r: numpy
# r: h5py

import numpy as np
import h5py
import Rhino.Geometry as rg

def get_port_id(m1_battr):
    if m1_battr == 1:
        return 3
    elif m1_battr == 2:
        return 0
    elif m1_battr == 3:
        return 2
    elif m1_battr == 4:
        return 1
    else:
        return "Error!"

crv_ls = [crv.GetLength() for crv in el_crvs]
L_joint = np.min(crv_ls)
crv_pts = []

# Create evaluation points
for crv in el_crvs:
    crv_pts.append([line.PointAt(0.5) for line in crv.ToPolyline().GetSegments()])

tol = 0.00001
if_list = []
for m1_id, crv in enumerate(el_crvs): # Iterate over element curves
    if np.abs(crv.GetLength() - L_joint) < tol: # If curve is a joint
        for j, crv_pt in enumerate(crv_pts[m1_id]): # Check all curve midpoints
            m1_battr = j + 1
            for m2_id, eval_crv in enumerate(crv_pts): # Iterate over checking points
                if m1_id != m2_id:
                    for l, eval_pt in enumerate(eval_crv):
                        distance = crv_pt.DistanceTo(eval_pt)
                        if distance < tol:
                            m2_battr = l + 1
                            port_id = get_port_id(m1_battr)
                            if_list.append([m1_id, m2_id, m1_battr, m2_battr, port_id])
if_data = np.array(if_list)
a = if_data
# ---------- end py3_5 ----------
join_2 = TextJoin(Text=[path, panel])
join_3 = TextJoin(Text=[path, join])
item_6 = ListItem(List=item_2, Index=Slider(2, range=0..2), Wrap=True)
join_4 = TextJoin(Text=[join_3, "linelast.3dcw_train"], Join="/")
join_5 = TextJoin(Text=[join_2, "linelast.3dcw_train"], Join="/")
py3_6 = Python3Script(if_data=py3_5)  # -> ifd_mapped
# ---------- py3_6: Python ----------
#! python 3

# r: numpy
# r: h5py
import numpy as np
arr = np.array(if_data)
row_len = arr.shape[0]

def map_cbattrs(m1_battr, m2_battr):
    # J2 -> V3, J3 -> H3, J4 -> V2, J5 -> H2
    if m1_battr == 1:
        assert m2_battr == 3
        m1b = 2
        m2b = 3
    elif m1_battr == 2:
        assert m2_battr == 4
        m1b = 3
        m2b = 3
    elif m1_battr == 3:
        assert m2_battr == 1
        m1b = 4
        m2b = 2
    elif m1_battr == 4:
        assert m2_battr == 2
        m1b = 5
        m2b = 2
    else:
        return "Error!"
    return m1b, m2b

def map_battrs(arr, row):
    # mesh1 / mesh2 / battr1 / battr2 / port_idx
    m1_battr = arr[row, 2]
    m2_battr = arr[row, 3]
    m1b, m2b = map_cbattrs(m1_battr, m2_battr)
    arr[row, 2] = m1b
    arr[row, 3] = m2b

for row in range(row_len):
    map_battrs(arr, row)

ifd_mapped = arr
# ---------- end py3_6 ----------
py3_7 = Python3Script(mesh_type=py3_4, bdr_data=py3_3)  # -> bdrd_mapped, a, b; inputs mesh_type: list of Int32
# ---------- py3_7: Python ----------
#! python 3

# r: numpy
# r: h5py
import numpy as np

def map_cbattr_joint(c_battr):
    return c_battr + 1

def map_cbattr_beamh(c_battr):
    if c_battr == 1 or c_battr == 3:
        return 1
    elif c_battr == 2:
        return 2
    elif c_battr == 4:
        return 3 

def map_cbattr_beamv(c_battr):
    if c_battr == 2 or c_battr == 4:
        return 1
    elif c_battr == 1:
        return 2
    elif c_battr == 3:
        return 3 

def map_cbattr(m_id, c_battr, mesh_type):
    m_type = mesh_type[m_id]
    if m_type == 0:
        return map_cbattr_joint(c_battr)
    elif m_type == 1:
        return map_cbattr_beamh(c_battr)
    elif m_type == 2:
        return map_cbattr_beamv(c_battr)
    else:
        return "error"
    
def map_battrs(arr, row, mesh_type):
    # global_battr / mesh_idx / comp_battr
    global_battr = arr[row, 0]
    mesh_idx = arr[row, 1]
    comp_battr = arr[row, 2]
    m1b = map_cbattr(mesh_idx, comp_battr, mesh_type)
    arr[row, 2] = m1b

arr = np.array(bdr_data)
row_len = arr.shape[0]

for row in range(row_len):
    map_battrs(arr, row, mesh_type)

unnecessary_rows = []
add_ids = []
for mesh_id in range(len(mesh_type)):
    neumann_count = 0
    for row in range(row_len):
        global_battr = arr[row, 0]
        mesh_idx = arr[row, 1]
        comp_battr = arr[row, 2]
        if global_battr == 5 and mesh_idx == mesh_id and comp_battr == 1:
            neumann_count += 1
            if neumann_count == 2:
                unnecessary_rows.append(row)
    if neumann_count == 0:
        add_ids.append(mesh_id)

arr = np.delete(arr, unnecessary_rows, axis = 0)
for mesh_idx in add_ids:
    newrow = [5, mesh_idx, 1]
    arr = np.vstack([arr, newrow])


bdrd_mapped = arr

a = add_ids
b = unnecessary_rows
# ---------- end py3_7 ----------
panel_2 = Panel(py3_3)
merge_2 = Merge(Data1=join_5, Data2=join_4)
panel_3 = Panel("""3dcw_joint
3dcw_beamH
3dcw_beamV""")
panel_4 = Panel(py3_7.bdrd_mapped)
py3_8 = Python3Script(
    ref_comps=item_2,
    mesh_type=py3_4,
    mesh_configs=py3_2,
    if_data=py3_5,
    bdr_data=py3_3,
    comp_list=panel_3,
    filenames=merge_2,
    write=Button())  # -> out, a; inputs ref_comps: list of Rectangle3d, mesh_type: list of Int32, comp_list: list of String, filenames: list of String, write: Boolean
# ---------- py3_8: Python ----------
#! python 3

# r: numpy
# r: h5py

import numpy as np
import h5py
import Rhino.Geometry as rg
import math

def GetDims(ref_comps):
    joint = ref_comps[0]
    beam = ref_comps[1]
    col = ref_comps[2]

    wj = joint.Height
    lj = joint.Width

    wh = beam.Height
    lh = beam.Width

    wv = col.Width
    lv = col.Height

    assert math.isclose(wh, wj)
    assert math.isclose(lj, wv)

    return wh, wv, lh, lv

battr_map = np.array(
[
    [1, 2 ,3, 4],
    [4, 1, 2 ,3],
    [3, 4, 1, 2],
    [2, 3, 4, 1]
])

def PermuteBdrData(bdr_data0, j):
    bdr_data = bdr_data0.copy()
    for i in range(bdr_data.shape[0]):
        battr = bdr_data[i, 0]
        if battr < 5:
            bdr_data[i, 0] = battr_map[j, battr-1]
    return bdr_data


def Configure2DLatticeComponent(f, comp_list, comp_configs, n_mesh, mesh_type, mesh_configs, if_data, bdr_data):
    # comp_list is a list of component names
    # comp_configs is a list of component configuration
    grp = f.create_group("components")
    grp.attrs["number_of_components"] = len(comp_list)
    grp.attrs["0"] = comp_list[0] # Joint component name
    grp.attrs["1"] = comp_list[1] # Horizontal rod component name
    grp.attrs["2"] = comp_list[2] # Vertical rod component name
    # component index of each mesh
    grp.create_dataset("meshes", (n_mesh,), data=mesh_type)
    # 3-dimension vector for translation / rotation
    grp.create_dataset("configuration", mesh_configs.shape, data=mesh_configs)

    grp = f.create_group("ports")
    grp.attrs["number_of_references"] = 4
    grp.attrs["0"] = "port1"
    grp.attrs["1"] = "port2"
    grp.attrs["2"] = "port3"
    grp.attrs["3"] = "port4"
    grp.create_dataset("interface", if_data.shape, data=if_data)

    port = grp.create_group("port1")
    port.attrs["comp1"] = comp_list[0] # Joint component name
    port.attrs["comp2"] = comp_list[1] # Horizontal rod component name
    port.attrs["attr1"] = 2
    port.attrs["attr2"] = 4
    port.create_dataset("comp2_configuration", (6,), data=comp_configs[0])

    port = grp.create_group("port2")
    port.attrs["comp1"] = comp_list[0] # Joint component name
    port.attrs["comp2"] = comp_list[1] # Horizontal rod component name
    port.attrs["attr1"] = 4
    port.attrs["attr2"] = 2
    port.create_dataset("comp2_configuration", (6,), data=comp_configs[1])

    port = grp.create_group("port3")
    port.attrs["comp1"] = comp_list[0] # Joint component name
    port.attrs["comp2"] = comp_list[2] # Vertical rod component name
    port.attrs["attr1"] = 3
    port.attrs["attr2"] = 1
    port.create_dataset("comp2_configuration", (6,), data=comp_configs[2])

    port = grp.create_group("port4")
    port.attrs["comp1"] = comp_list[0] # Joint component name
    port.attrs["comp2"] = comp_list[2] # Vertical rod component name
    port.attrs["attr1"] = 1
    port.attrs["attr2"] = 3
    port.create_dataset("comp2_configuration", (6,), data=comp_configs[3])

    # boundary attributes
    f.create_dataset("boundary", bdr_data.shape, data=bdr_data)

def CWTrainOptROM(ref_comps, mesh_type, mesh_configs, if_data, bdr_data, comp_list, filename):
    wh, wv, lh, lv = GetDims(ref_comps)
    n_mesh = len(mesh_type)

    # component config list J-H H-J J-V V-J
    # Assuming lattice structure
    comp_configs = []
    comp_configs += [[wv, 0., 0., 0., 0., 0.]]
    comp_configs += [[-lh, 0., 0., 0., 0., 0.]]
    comp_configs += [[0., wh, 0., 0., 0., 0.]]
    comp_configs += [[0., -lv, 0., 0., 0., 0.]]

    for i in range(4): # Loop over all the variants
        bdr_data_i = PermuteBdrData(bdr_data, i)
        filename_i = filename + str(i) + ".h5"
        with h5py.File(filename_i, 'w') as f:
            # c++ currently cannot read datasets of string.
            # change to multiple attributes, only as a temporary implementation.
            Configure2DLatticeComponent(f, comp_list, comp_configs, n_mesh, mesh_type, mesh_configs, if_data, bdr_data_i)
    return

# Main
if write == True:
    for filename in filenames:
        CWTrainOptROM(ref_comps,mesh_type, mesh_configs, if_data, bdr_data, comp_list, filename)
# ---------- end py3_8 ----------
panel_5 = Panel(py3_8.out)
