# Grasshopper definition ComponentDefinition.gh (Grasshopper 1.0.8)
# plug-ins: RhinoCodePluginGH

# ---- group: Get surfaces from layer
pipeline = GeometryPipeline(
    GroupByLayer=False,
    GroupByType=False,
    IncludeHidden=True,
    IncludeLocked=True,
    LayerFilter="Joint::1",
    NameFilter="*",
    SublayerFiltering=True,
    TypeFilter=1073741848)
pipeline_2 = GeometryPipeline(
    GroupByLayer=False,
    GroupByType=False,
    IncludeHidden=True,
    IncludeLocked=True,
    LayerFilter="Joint::2",
    NameFilter="*",
    SublayerFiltering=True,
    TypeFilter=1073741848)
pipeline_3 = GeometryPipeline(
    GroupByLayer=False,
    GroupByType=False,
    IncludeHidden=True,
    IncludeLocked=True,
    LayerFilter="Joint::3",
    NameFilter="*",
    SublayerFiltering=True,
    TypeFilter=1073741848)
pipeline_4 = GeometryPipeline(
    GroupByLayer=False,
    GroupByType=False,
    IncludeHidden=True,
    IncludeLocked=True,
    LayerFilter="Joint::4",
    NameFilter="*",
    SublayerFiltering=True,
    TypeFilter=1073741848)
pipeline_5 = GeometryPipeline(
    GroupByLayer=False,
    GroupByType=False,
    IncludeHidden=True,
    IncludeLocked=True,
    LayerFilter="Joint::5",
    NameFilter="*",
    SublayerFiltering=True,
    TypeFilter=1073741848)
srf = Surface(pipeline)
srf_2 = Surface(pipeline_2)
srf_3 = Surface(pipeline_3)
srf_4 = Surface(pipeline_4)
srf_5 = Surface(pipeline_5)
merge = Merge(Data1=srf, Data2=srf_2, Data3=srf_3, Data4=srf_4)

pipeline_6 = GeometryPipeline(
    GroupByLayer=False,
    GroupByType=False,
    IncludeHidden=True,
    IncludeLocked=True,
    LayerFilter="BeamV::1",
    NameFilter="*",
    SublayerFiltering=True,
    TypeFilter=1073741848)
pipeline_7 = GeometryPipeline(
    GroupByLayer=False,
    GroupByType=False,
    IncludeHidden=True,
    IncludeLocked=True,
    LayerFilter="BeamV::2",
    NameFilter="*",
    SublayerFiltering=True,
    TypeFilter=1073741848)
pipeline_8 = GeometryPipeline(
    GroupByLayer=False,
    GroupByType=False,
    IncludeHidden=True,
    IncludeLocked=True,
    LayerFilter="BeamV::3",
    NameFilter="*",
    SublayerFiltering=True,
    TypeFilter=1073741848)
pipeline_9 = GeometryPipeline(
    GroupByLayer=False,
    GroupByType=False,
    IncludeHidden=True,
    IncludeLocked=True,
    LayerFilter="BeamV::4",
    NameFilter="*",
    SublayerFiltering=True,
    TypeFilter=1073741848)
pipeline_10 = GeometryPipeline(
    GroupByLayer=False,
    GroupByType=False,
    IncludeHidden=True,
    IncludeLocked=True,
    LayerFilter="BeamV::5",
    NameFilter="*",
    SublayerFiltering=True,
    TypeFilter=1073741848)
srf_6 = Surface(pipeline_6)
srf_7 = Surface(pipeline_7)
srf_8 = Surface(pipeline_8)
srf_9 = Surface(pipeline_9)
srf_10 = Surface(pipeline_10)
merge_2 = Merge(Data1=srf_6, Data2=srf_7, Data3=srf_8, Data4=srf_9)

pipeline_11 = GeometryPipeline(
    GroupByLayer=False,
    GroupByType=False,
    IncludeHidden=True,
    IncludeLocked=True,
    LayerFilter="BeamH::1",
    NameFilter="*",
    SublayerFiltering=True,
    TypeFilter=1073741848)
pipeline_12 = GeometryPipeline(
    GroupByLayer=False,
    GroupByType=False,
    IncludeHidden=True,
    IncludeLocked=True,
    LayerFilter="BeamH::2",
    NameFilter="*",
    SublayerFiltering=True,
    TypeFilter=1073741848)
pipeline_13 = GeometryPipeline(
    GroupByLayer=False,
    GroupByType=False,
    IncludeHidden=True,
    IncludeLocked=True,
    LayerFilter="BeamH::3",
    NameFilter="*",
    SublayerFiltering=True,
    TypeFilter=1073741848)
pipeline_14 = GeometryPipeline(
    GroupByLayer=False,
    GroupByType=False,
    IncludeHidden=True,
    IncludeLocked=True,
    LayerFilter="BeamH::4",
    NameFilter="*",
    SublayerFiltering=True,
    TypeFilter=1073741848)
pipeline_15 = GeometryPipeline(
    GroupByLayer=False,
    GroupByType=False,
    IncludeHidden=True,
    IncludeLocked=True,
    LayerFilter="BeamH::5",
    NameFilter="*",
    SublayerFiltering=True,
    TypeFilter=1073741848)
srf_11 = Surface(pipeline_11)
srf_12 = Surface(pipeline_12)
srf_13 = Surface(pipeline_13)
srf_14 = Surface(pipeline_14)
srf_15 = Surface(pipeline_15)
merge_3 = Merge(Data1=srf_11, Data2=srf_12, Data3=srf_13, Data4=srf_14)

# ---- group: Get surfaces from layer / Inhomogenous BC
srf_16 = Surface(merge)

# ---- group: Get surfaces from layer / Homogenous BCs
srf_17 = Surface(srf_5)

# ---- group: Get surfaces from layer / Inhomogenous BC
srf_18 = Surface(merge_2)

# ---- group: Get surfaces from layer / Homogenous BCs
srf_19 = Surface(srf_10)

# ---- group: Get surfaces from layer / Inhomogenous BC
srf_20 = Surface(merge_3)

# ---- group: Get surfaces from layer / Homogenous BCs
srf_21 = Surface(srf_15)

# ---- group: Prepare geometry and BCs / Inhomogenous BC
srf_22 = Surface(srf_16)

# ---- group: Prepare geometry and BCs / Homogenous BCs
srf_23 = Surface(srf_17)

# ---- group: Prepare geometry and BCs / Sort non rectangular faces
rec = Rectangle(srf_22)
null = NullItem(Item=rec)  # -> NullFlags, InvalidFlags, Description
dispatch = Dispatch(List=srf_22, DispatchPattern=null.NullFlags)  # -> ListA, ListB

# ---- group: Prepare geometry and BCs / Inhomogenous BC
srf_24 = Surface(srf_18)

# ---- group: Prepare geometry and BCs / Homogenous BCs
srf_25 = Surface(srf_19)

# ---- group: Prepare geometry and BCs / Sort non rectangular faces
rec_2 = Rectangle(srf_24)
null_2 = NullItem(Item=rec_2)  # -> NullFlags, InvalidFlags, Description
dispatch_2 = Dispatch(List=srf_24, DispatchPattern=null_2.NullFlags)  # -> ListA, ListB

# ---- group: Prepare geometry and BCs / Inhomogenous BC
srf_26 = Surface(srf_20)

# ---- group: Prepare geometry and BCs / Homogenous BCs
srf_27 = Surface(srf_21)

# ---- group: Prepare geometry and BCs / Sort non rectangular faces
rec_3 = Rectangle(srf_26)
null_3 = NullItem(Item=rec_3)  # -> NullFlags, InvalidFlags, Description
dispatch_3 = Dispatch(List=srf_26, DispatchPattern=null_3.NullFlags)  # -> ListA, ListB

# ---- group: Prepare geometry and BCs / Non rectangular
srf_28 = Surface(dispatch.ListA)

# ---- group: Prepare geometry and BCs / Rectangular
srf_29 = Surface(dispatch.ListB)

# ---- group: Prepare geometry and BCs / dividemap
bool = Boolean(null.NullFlags)

# ---- group: Prepare geometry and BCs / Split faces with holes
wires = BrepWireframe(Brep=srf_28, Density=-1)
join = JoinCurves(Curves=wires, Preserve=False)
area = Area(Geometry=join)  # -> Area, Centroid
avr = Average(Input=area.Centroid)
line = LineSDL(Start=avr, Direction=Vector(0, 0, 1), Length=Slider(100, range=0..100))
ccx = CurveCurve(CurveA=simplify(line), CurveB=simplify(join))  # -> Points, ParamsA, ParamsB
trim = TrimTree(Tree=ccx.ParamsB, Depth=1)
seam = Seam(Curve=simplify(join), Seam=simplify(trim))
disc = Discontinuity(Curve=seam, Level=1)  # -> simplify(Points), Parameters
item = ListItem(List=seam, Index=0, Wrap=True)
dup = DuplicateData(Data=item, Number=Slider(2, range=0..10), Order=True)
graft = GraftTree(Tree=dup, IncludeEmptyLists=True, IncludeNullItems=True)  # -> simplify(Tree)
alongcrv = SortAlongCurve(Points=disc.Points, Curve=graft)  # -> Points, Indices
py3 = Python3Script(corner_tree=alongcrv.Points)  # -> out, a; inputs corner_tree: tree of Point3d
# ---------- py3: Python ----------
import ghpythonlib.treehelpers as th

def Tree2List(tree):
    
    b1 = []
    
    for i in range(tree.BranchCount):
        b1.append(tree.Path(i)[0])
    a = [[] for i in list(set(b1))] # Structure corresponding to sides
    print(a)
    print(b1)
    for i in range(len(a)): # Loop over sides
        first_br_id = i*2 # Assuming 2 curves
        second_br_id = first_br_id + 1
        first_br=tree.Branch(first_br_id)
        second_br=tree.Branch(second_br_id)
        br_len = len(first_br)
        for j in range(br_len): # For every point 
            print([first_br[j], second_br[j]])
            a[i].append([first_br[j], second_br[j]])
    return a

corner_list = Tree2List(corner_tree)
layerTree = th.list_to_tree(corner_list, source=[0,0])
a = layerTree
# ---------- end py3 ----------
pline = PolyLine(Vertices=py3.a, Closed=False)
trim_2 = TrimTree(Tree=pline, Depth=1)  # -> simplify(Tree)
srfsplit = SurfaceSplit(Surface=simplify(graft(srf_28)), Curves=trim_2)

# ---- group: Prepare geometry and BCs / Non rectangular
srf_30 = Surface(dispatch_2.ListA)

# ---- group: Prepare geometry and BCs / Rectangular
srf_31 = Surface(dispatch_2.ListB)

# ---- group: Prepare geometry and BCs / dividemap
bool_2 = Boolean(null_2.NullFlags)

# ---- group: Prepare geometry and BCs / Split faces with holes
wires_2 = BrepWireframe(Brep=srf_30, Density=-1)
join_2 = JoinCurves(Curves=wires_2, Preserve=False)
area_2 = Area(Geometry=join_2)  # -> Area, Centroid
avr_2 = Average(Input=area_2.Centroid)
line_2 = LineSDL(Start=avr_2, Direction=Vector(0, 0, 1), Length=Slider(100, range=0..100))
ccx_2 = CurveCurve(CurveA=simplify(line_2), CurveB=simplify(join_2))  # -> Points, ParamsA, ParamsB
trim_3 = TrimTree(Tree=ccx_2.ParamsB, Depth=1)
seam_2 = Seam(Curve=simplify(join_2), Seam=simplify(trim_3))
disc_2 = Discontinuity(Curve=seam_2, Level=1)  # -> simplify(Points), Parameters
item_2 = ListItem(List=seam_2, Index=0, Wrap=True)
dup_2 = DuplicateData(Data=item_2, Number=Slider(2, range=0..10), Order=True)
graft_2 = GraftTree(Tree=dup_2, IncludeEmptyLists=True, IncludeNullItems=True)  # -> simplify(Tree)
alongcrv_2 = SortAlongCurve(Points=disc_2.Points, Curve=graft_2)  # -> Points, Indices
py3_2 = Python3Script(corner_tree=alongcrv_2.Points)  # -> out, a; inputs corner_tree: tree of Point3d; same code as py3
pline_2 = PolyLine(Vertices=py3_2.a, Closed=False)
trim_4 = TrimTree(Tree=pline_2, Depth=1)  # -> simplify(Tree)
srfsplit_2 = SurfaceSplit(Surface=simplify(graft(srf_30)), Curves=trim_4)

# ---- group: Prepare geometry and BCs / Non rectangular
srf_32 = Surface(dispatch_3.ListA)

# ---- group: Prepare geometry and BCs / Rectangular
srf_33 = Surface(dispatch_3.ListB)

# ---- group: Prepare geometry and BCs / dividemap
bool_3 = Boolean(null_3.NullFlags)

# ---- group: Prepare geometry and BCs / Split faces with holes
wires_3 = BrepWireframe(Brep=srf_32, Density=-1)
join_3 = JoinCurves(Curves=wires_3, Preserve=False)
area_3 = Area(Geometry=join_3)  # -> Area, Centroid
avr_3 = Average(Input=area_3.Centroid)
line_3 = LineSDL(Start=avr_3, Direction=Vector(0, 0, 1), Length=Slider(100, range=0..100))
ccx_3 = CurveCurve(CurveA=simplify(line_3), CurveB=simplify(join_3))  # -> Points, ParamsA, ParamsB
trim_5 = TrimTree(Tree=ccx_3.ParamsB, Depth=1)
seam_3 = Seam(Curve=simplify(join_3), Seam=simplify(trim_5))
disc_3 = Discontinuity(Curve=seam_3, Level=1)  # -> simplify(Points), Parameters
item_3 = ListItem(List=seam_3, Index=0, Wrap=True)
dup_3 = DuplicateData(Data=item_3, Number=Slider(2, range=0..10), Order=True)
graft_3 = GraftTree(Tree=dup_3, IncludeEmptyLists=True, IncludeNullItems=True)  # -> simplify(Tree)
alongcrv_3 = SortAlongCurve(Points=disc_3.Points, Curve=graft_3)  # -> Points, Indices
py3_3 = Python3Script(corner_tree=alongcrv_3.Points)  # -> out, a; inputs corner_tree: tree of Point3d; same code as py3
pline_3 = PolyLine(Vertices=py3_3.a, Closed=False)
trim_6 = TrimTree(Tree=pline_3, Depth=1)  # -> simplify(Tree)
srfsplit_3 = SurfaceSplit(Surface=simplify(graft(srf_32)), Curves=trim_6)

# ----
number_slider = Slider(0.5, range=0..1)
dispatch_4 = Dispatch(List=simplify(py3.a), DispatchPattern=[True, False])  # -> ListA, ListB
pt = ConstructPoint(XCoordinate=number_slider, YCoordinate=number_slider, ZCoordinate=0)
trim_7 = TrimTree(Tree=dispatch_4.ListA, Depth=1)  # -> simplify(Tree)
trim_8 = TrimTree(Tree=dispatch_4.ListB, Depth=1)  # -> simplify(Tree)
evalsrf = EvaluateSurface(Surface=reparameterize(srf_28), Point=pt)  # -> Point, Normal, UDirection, VDirection, Frame
pl = ConstructPlane(Origin=evalsrf.Point, XAxis=evalsrf.UDirection, YAxis=evalsrf.VDirection)
rec_2pt = Rectangle2Pt(Plane=graft(pl), PointA=simplify(trim_7), PointB=simplify(trim_8), Radius=0)  # -> simplify(Rectangle), Length
srfsplit_4 = SurfaceSplit(Surface=simplify(graft(srf_28)), Curves=rec_2pt.Rectangle)

# ---- group: Prepare geometry and BCs / homogenous neumann
srf_34 = Surface(srf_23)

# ---- group: Prepare geometry and BCs / BC divide map
bool_4 = Boolean(bool)

# ----
disc_4 = Discontinuity(Curve=srfsplit, Level=1)  # -> simplify(Points), Parameters
disc_5 = Discontinuity(Curve=srfsplit_2, Level=1)  # -> simplify(Points), Parameters
pline_4 = PolyLine(Vertices=disc_4.Points, Closed=invert(False))

# ---- group: Prepare geometry and BCs / homogenous neumann
srf_35 = Surface(srf_25)

# ---- group: Prepare geometry and BCs / BC divide map
bool_5 = Boolean(bool_2)

# ----
pline_5 = PolyLine(Vertices=disc_5.Points, Closed=invert(False))
boundary = BoundarySurfaces(Edges=pline_4)

# ---- group: Prepare geometry and BCs / divided BC
srf_36 = Surface(boundary)

# ----
trim_9 = TrimTree(Tree=srf_36, Depth=1)
disc_6 = Discontinuity(Curve=srfsplit_3, Level=1)  # -> simplify(Points), Parameters
boundary_2 = BoundarySurfaces(Edges=pline_5)
pline_6 = PolyLine(Vertices=disc_6.Points, Closed=invert(False))
trim_10 = TrimTree(Tree=boundary_2, Depth=1)

# ---- group: Prepare geometry and BCs / divided BC
srf_37 = Surface(trim_10)

# ----
boundary_3 = BoundarySurfaces(Edges=pline_6)

# ---- group: Prepare geometry and BCs / BC divide map
bool_6 = Boolean(bool_3)

# ----
trim_11 = TrimTree(Tree=boundary_3, Depth=1)

# ---- group: Prepare geometry and BCs / homogenous neumann
srf_38 = Surface(srf_27)

# ---- group: Prepare geometry and BCs / divided BC
srf_39 = Surface(trim_11)

# ----
number_slider_2 = Slider(4, range=0..10)
flatten = FlattenTree(Tree=trim_10, Path="{0}")
graft_4 = GraftTree(Tree=simplify(flatten), IncludeEmptyLists=True, IncludeNullItems=True)  # -> simplify(Tree)
number_slider_3 = Slider(4, range=0..10)
flatten_2 = FlattenTree(Tree=trim_11, Path="{0}")
flatten_3 = FlattenTree(Tree=boundary, Path="{0}")
graft_5 = GraftTree(Tree=simplify(flatten_2), IncludeEmptyLists=True, IncludeNullItems=True)  # -> simplify(Tree)
graft_6 = GraftTree(Tree=simplify(flatten_3), IncludeEmptyLists=True, IncludeNullItems=True)  # -> simplify(Tree)
number_slider_4 = Slider(4, range=0..10)
number_slider_5 = Slider(4, range=0..10)
sdivide = DivideSurface(Surface=reparameterize(graft_4), UCount=number_slider_3, VCount=number_slider_3)  # -> Points, Normals, Parameters
bool_7 = Boolean(Button())
path = FilePath("/Users/larsson4/repos/LinelastPaper/Rhino/export_meshes/")
trim_12 = TrimTree(Tree=simplify(sdivide.Points), Depth=1)
sdivide_2 = DivideSurface(Surface=reparameterize(graft_5), UCount=number_slider_4, VCount=number_slider_4)  # -> Points, Normals, Parameters
sdivide_3 = DivideSurface(Surface=reparameterize(graft_6), UCount=number_slider_5, VCount=number_slider_5)  # -> Points, Normals, Parameters
incurve = PointInCurve(Point=trim_12, Curve=graft_4)  # -> Relationship, Point
trim_13 = TrimTree(Tree=simplify(sdivide_2.Points), Depth=1)
trim_14 = TrimTree(Tree=simplify(sdivide_3.Points), Depth=1)
subtraction = Subtraction(A=incurve.Relationship, B=1)
bool_8 = Boolean(subtraction)
incurve_2 = PointInCurve(Point=trim_13, Curve=graft_5)  # -> Relationship, Point
incurve_3 = PointInCurve(Point=trim_14, Curve=graft_6)  # -> Relationship, Point
cull = CullPattern(List=trim_12, CullPattern=bool_8)
subtraction_2 = Subtraction(A=incurve_2.Relationship, B=1)
subtraction_3 = Subtraction(A=incurve_3.Relationship, B=1)
bool_9 = Boolean(subtraction_2)
bool_10 = Boolean(subtraction_3)
cull_2 = CullPattern(List=trim_13, CullPattern=bool_9)
cull_3 = CullPattern(List=trim_14, CullPattern=bool_10)

# ---- group: Prepare geometry and BCs
lng = ListLength(List=trim_9)  # -> flatten(Length)
lng_2 = ListLength(List=srf_34)
py3_4 = Python3Script(bc_divide_map=bool_4, len_bcdivide=lng, len_hneumann=lng_2)  # -> out, ids; inputs bc_divide_map: list of Boolean, len_bcdivide: list of Int32, len_hneumann: Int32
# ---------- py3_4: Python ----------
"""Grasshopper Script"""

battr_list = []
ctr_div = 0

for i, divided in enumerate(bc_divide_map):
    if divided:
        battr_list.extend([i+1] * len_bcdivide[ctr_div])
        ctr_div += 1
    else:
        battr_list.append(i+1)

battr_list.extend([5] * len_hneumann)
ids = battr_list
# ---------- end py3_4 ----------

# ----
py3_5 = Python3Script(div_bc=flatten(boundary), undiv_bc=srf_29, mapdiv=bool_4, len_div=lng)  # -> out, merged_bc; inputs div_bc: list of Surface, undiv_bc: list of Surface, mapdiv: list of Boolean, len_div: list of Int32
# ---------- py3_5: Python ----------
merge_list = []
ctr_div = 0
ctr_divbc = 0
ctr_undiv = 0
for i,divided in enumerate(mapdiv):
    if divided:
        for j in range(len_div[ctr_divbc]):
            merge_list.append(div_bc[ctr_div])
            ctr_div += 1
        ctr_divbc += 1
    else:
        merge_list.append(undiv_bc[ctr_undiv])
        ctr_undiv += 1

merged_bc = merge_list
# ---------- end py3_5 ----------

# ---- group: Prepare geometry and BCs (continued)
merge_4 = Merge(Data1=flatten(py3_5.merged_bc), Data2=srf_23)  # -> flatten(Result)

# ---- group: Prepare geometry and BCs / rebuild surfaces
disc_7 = Discontinuity(Curve=merge_4, Level=1)  # -> simplify(Points), Parameters
pline_7 = PolyLine(Vertices=disc_7.Points, Closed=invert(False))

# ---- group: Prepare geometry and BCs (continued)
explode = Explode(Curve=pline_7, Recursive=True)  # -> Segments, Vertices
divide = DivideCurve(Curve=explode.Segments, Count=number_slider_2, Kinks=False)  # -> Points, Tangents, Parameters
pline_8 = PolyLine(Vertices=divide.Points, Closed=False)
trim_15 = TrimTree(Tree=pline_8, Depth=1)
item_4 = ListItem(List=trim_15, Index=0, Wrap=True)  # -> Item, Item1, Item2, Item3
edgesrf = EdgeSurface(CurveA=item_4.Item, CurveB=item_4.Item1, CurveC=item_4.Item2, CurveD=item_4.Item3)  # -> flatten(Surface)
boundary_4 = BoundarySurfaces(Edges=pline_7)  # -> flatten(Surfaces)
flip = Flip(Surface=edgesrf)  # -> Surface, Result

# ---- group: Prepare geometry and BCs / Inputs
int = Integer(py3_4.ids)
srf_40 = Surface(flip.Surface)

# ----
py3_6 = Python3Script(
    face_list=srf_40,
    face_id_list=int,
    pt_constraints=cull_3,
    mapdiv=bool_4,
    len_div=lng,
    filename="3dcw_joint",
    directory=path,
    export=bool_7)  # -> out, a, b; inputs face_list: list of Surface, face_id_list: list of Int32, pt_constraints: tree of Point3d, mapdiv: list of Boolean, len_div: list of Int32, filename: String, export: String
# ---------- py3_6: Python ----------
# venv: site-packages
# r: gmsh

import gmsh
import os
import Rhino.Geometry as rg

# Start up GMSH file
gmsh.initialize()
gmsh.model.add(filename)
gmsh.option.setNumber("Mesh.MshFileVersion", 2.2)

# Should return ordered list of surface points to generate the surface
def GetCorners(srf): 
    brep = srf.ToBrep()
    edge_poly = rg.Curve.JoinCurves(brep.DuplicateEdgeCurves())[0]
    return [edge_poly.Point(i) for i in range(edge_poly.PointCount)]

def Surface2GMSH(srf, cp, cc, cs):
    lc = 10.0
    pts = GetCorners(srf)
    for i, pt in enumerate(pts):
        gmsh.model.geo.addPoint(pt.X, pt.Y, pt.Z, lc, cp + i)
    # Create the lines:
    for i, pt in enumerate(pts):
        if i ==len(pts)-1:
            gmsh.model.geo.addLine(cp+i,cp,cc+i)
        else:
            gmsh.model.geo.addLine(cp+i,cp+i+1,cc+i)
    # Create Curve Loop
    gmsh.model.geo.addCurveLoop([cc + i for i in range(len(pts))], cs)
    gmsh.model.geo.addPlaneSurface([cs], cs)
    return len(pts)

def GetBattrIds(face_id_list):
    battr_ids = []
    max_id = max(face_id_list)
    for i in range(max_id):
        _id = i+1
        ids = [j_id + 1 for j_id, j in enumerate(face_id_list) if j == _id]
        battr_ids.append(ids)
    return battr_ids

def Volume2GMSH(srflist, battrlist, filename, directory):
    ctr_pt = 1
    ctr_crv = 1
    ctr_srf = 1
    for srf in srflist:
        pt_step = Surface2GMSH(srf, ctr_pt, ctr_crv, ctr_srf)
        ctr_pt += pt_step
        ctr_crv += pt_step
        ctr_srf += 1
        
    # Add surface loop, should be generalized for arbitrary surfaces
    gmsh.model.geo.addSurfaceLoop([i+1 for i in range(len(face_list))], 1)
    gmsh.model.geo.addVolume([1], 1)
    # Synchronize model
    gmsh.model.geo.synchronize()
    gmsh.model.geo.removeAllDuplicates()
    gmsh.model.geo.synchronize()
    # Add physical groups
    battrids = GetBattrIds(battrlist)
    for i in range(len(battrids)):
        gmsh.model.addPhysicalGroup(2, battrids[i], i+1)
    gmsh.model.addPhysicalGroup(3, [1], 1)
    
    gmsh.model.geo.synchronize()

    srf_ctr = 1
    ctr_divbc = 0
    ctr_div = 0
    for i,divided in enumerate(mapdiv):
        if divided:
            for k in range(len_div[ctr_div]):
                constr_pts = pt_constraints.Branch(ctr_divbc)
                for j, pt in enumerate(constr_pts):
                    gmsh.model.geo.addPoint(pt.X, pt.Y, pt.Z, 10.0, ctr_pt)
                    gmsh.model.geo.synchronize()
                    gmsh.model.mesh.embed(0, [ctr_pt], 2, srf_ctr)
                    ctr_pt += 1
                srf_ctr += 1
                ctr_divbc += 1
        else:
            srf_ctr += 1
    
    gmsh.model.geo.synchronize()
    gmsh.option.setNumber("Mesh.Algorithm", 1)
    #gmsh.option.setNumber("Mesh.RecombineAll", 1)
    # Mesh surface
    gmsh.model.mesh.generate(3)
    # Write mesh
    gmsh.write(os.path.join(directory, filename)+".msh")

# Main script
if export:
    Volume2GMSH(face_list, face_id_list, filename, directory)
test_face = face_list[13].ToBrep()
''' for i, battr in enumerate(battrlist):
        gmsh.model.addPhysicalGroup(2, [i+1], battr) '''

a = GetBattrIds(face_id_list)


# Quit GMSH
gmsh.finalize()
# ---------- end py3_6 ----------
panel = Panel(py3_6.b)
panel_2 = Panel(py3_6.a)
panel_3 = Panel(py3_6.out)

# ---- group: Prepare geometry and BCs
lng_3 = ListLength(List=srf_37)  # -> flatten(Length)
lng_4 = ListLength(List=srf_35)
py3_7 = Python3Script(bc_divide_map=bool_5, len_bcdivide=lng_3, len_hneumann=lng_4)  # -> out, ids; inputs bc_divide_map: list of Boolean, len_bcdivide: list of Int32, len_hneumann: Int32; same code as py3_4

# ----
py3_8 = Python3Script(div_bc=flatten(trim_10), undiv_bc=srf_31, mapdiv=bool_5, len_div=lng_3)  # -> out, merged_bc; inputs div_bc: list of Surface, undiv_bc: list of Surface, mapdiv: list of Boolean, len_div: list of Int32; same code as py3_5

# ---- group: Prepare geometry and BCs (continued)
merge_5 = Merge(Data1=flatten(py3_8.merged_bc), Data3=srf_25)  # -> flatten(Result)

# ---- group: Prepare geometry and BCs / rebuild surfaces
disc_8 = Discontinuity(Curve=merge_5, Level=1)  # -> simplify(Points), Parameters
pline_9 = PolyLine(Vertices=disc_8.Points, Closed=invert(False))

# ---- group: Prepare geometry and BCs (continued)
explode_2 = Explode(Curve=pline_9, Recursive=True)  # -> Segments, Vertices
divide_2 = DivideCurve(Curve=explode_2.Segments, Count=number_slider_2, Kinks=False)  # -> Points, Tangents, Parameters
pline_10 = PolyLine(Vertices=divide_2.Points, Closed=False)
trim_16 = TrimTree(Tree=pline_10, Depth=1)
item_5 = ListItem(List=trim_16, Index=0, Wrap=True)  # -> Item, Item1, Item2, Item3
edgesrf_2 = EdgeSurface(CurveA=item_5.Item, CurveB=item_5.Item1, CurveC=item_5.Item2, CurveD=item_5.Item3)  # -> flatten(Surface)
boundary_5 = BoundarySurfaces(Edges=pline_9)  # -> flatten(Surfaces)
flip_2 = Flip(Surface=edgesrf_2)  # -> Surface, Result

# ---- group: Prepare geometry and BCs / Inputs
int_2 = Integer(py3_7.ids)
srf_41 = Surface(flip_2.Surface)

# ----
py3_9 = Python3Script(
    face_list=srf_41,
    face_id_list=int_2,
    pt_constraints=cull,
    mapdiv=bool_5,
    len_div=lng_3,
    filename="3dcw_beamV",
    directory=path,
    export=bool_7)  # -> out, a, b; inputs face_list: list of Surface, face_id_list: list of Int32, pt_constraints: tree of Point3d, mapdiv: list of Boolean, len_div: list of Int32, filename: String, export: String; same code as py3_6

# ---- group: Prepare geometry and BCs
lng_5 = ListLength(List=srf_39)  # -> flatten(Length)
lng_6 = ListLength(List=srf_38)
py3_10 = Python3Script(bc_divide_map=bool_6, len_bcdivide=lng_5, len_hneumann=lng_6)  # -> out, ids; inputs bc_divide_map: list of Boolean, len_bcdivide: list of Int32, len_hneumann: Int32; same code as py3_4

# ----
py3_11 = Python3Script(div_bc=flatten(trim_11), undiv_bc=srf_33, mapdiv=bool_6, len_div=lng_5)  # -> out, merged_bc; inputs div_bc: list of Surface, undiv_bc: list of Surface, mapdiv: list of Boolean, len_div: list of Int32; same code as py3_5

# ---- group: Prepare geometry and BCs (continued)
merge_6 = Merge(Data1=flatten(py3_11.merged_bc), Data3=srf_27)  # -> flatten(Result)

# ---- group: Prepare geometry and BCs / rebuild surfaces
disc_9 = Discontinuity(Curve=merge_6, Level=1)  # -> simplify(Points), Parameters
pline_11 = PolyLine(Vertices=disc_9.Points, Closed=invert(False))

# ---- group: Prepare geometry and BCs (continued)
explode_3 = Explode(Curve=pline_11, Recursive=True)  # -> Segments, Vertices
divide_3 = DivideCurve(Curve=explode_3.Segments, Count=number_slider_2, Kinks=False)  # -> Points, Tangents, Parameters
pline_12 = PolyLine(Vertices=divide_3.Points, Closed=False)
trim_17 = TrimTree(Tree=pline_12, Depth=1)
item_6 = ListItem(List=trim_17, Index=0, Wrap=True)  # -> Item, Item1, Item2, Item3
edgesrf_3 = EdgeSurface(CurveA=item_6.Item, CurveB=item_6.Item1, CurveC=item_6.Item2, CurveD=item_6.Item3)  # -> flatten(Surface)
boundary_6 = BoundarySurfaces(Edges=pline_11)  # -> flatten(Surfaces)
flip_3 = Flip(Surface=edgesrf_3)  # -> Surface, Result

# ---- group: Prepare geometry and BCs / Inputs
int_3 = Integer(py3_10.ids)
srf_42 = Surface(flip_3.Surface)

# ----
py3_12 = Python3Script(
    face_list=srf_42,
    face_id_list=int_3,
    pt_constraints=cull_2,
    mapdiv=bool_6,
    len_div=lng_5,
    filename="3dcw_beamH",
    directory=path,
    export=bool_7)  # -> out, a, b; inputs face_list: list of Surface, face_id_list: list of Int32, pt_constraints: tree of Point3d, mapdiv: list of Boolean, len_div: list of Int32, filename: String, export: String; same code as py3_6
